# Grasshopper definition A bit of everything.gh (Grasshopper 1.0.7)
# plug-ins: Koala

bottom_corners = Point([Point(0, 0, 0), Point(0, 5, 0), Point(5, 5, 0), Point(6, 0, 0)])
top_corners = Point([Point(0, 0, 5), Point(0, 5, 5), Point(5, 6, 5), Point(5, 0, 5)])

corners_opening1 = Point([Point(1, 4, 0), Point(1, 3, 0), Point(2, 2, 0), Point(2, 3, 0)])
corners_opening2 = Point([Point(4.477725388, 4.361003126, 0), Point(3.251194741, 3.97633032, 0), Point(3.579012479, 3.051056056, 0), Point(4.530503806, 3, 0)])

# ---- group: Load panel positions
number_slider = Slider(0.3, range=0..1)
number_slider_2 = Slider(0.6, range=0..1)

# ----
# Geometry
polyline = PolyLine(Vertices=bottom_corners, Closed=True)
polyline_2 = PolyLine(Vertices=top_corners, Closed=True)
line = Line(StartPoint=bottom_corners, EndPoint=top_corners)
entwine = Entwine(Branch00=corners_opening1, Branch01=corners_opening2, FlattenInputs=True)
polyline_3 = PolyLine(Vertices=entwine, Closed=True)
merge = Merge(Data1=polyline, Data2=polyline_2)
column_lines = Line(line)
evaluate_curve = EvaluateCurve(Curve=column_lines, Parameter=graft([number_slider, number_slider_2]))  # -> Point, Tangent, Angle
surface_top_bottom = Surface(merge)
panel = Panel("""0.3
0.9""")
shift_list = ShiftList(List=evaluate_curve.Point, Shift=1, Wrap=True)
evaluate_curve_2 = EvaluateCurve(Curve=reparameterize(graft(surface_top_bottom)), Parameter=panel)  # -> Point, Tangent, Angle
polyline_4 = PolyLine(Vertices=shift_list, Closed=True)
surface_for_load_panels = Surface(polyline_4)
polyline_5 = PolyLine(Vertices=evaluate_curve_2.Point, Closed=False)  # -> flatten(Polyline)
line_internal_surface_edge = Line(polyline_5)

node = Node(Point=[Point(1, 1, 0), Point(1, 2, 0)], NodePrefix="NSp")
list_item = ListItem(List=node, Index=0, Wrap=True)  # -> flatten(Item)

cross_sections = Panel("""CS1
CS7
CS10
CS13""")
layer = Panel("Beams")

panel_2 = Panel("""constant|300
constant|450""")
layer_2 = Panel("Surfaces")
control_knob = ControlKnob(Decimals=0, Limit=False, Maximum=10, Minimum=0, Range=360, Value=0)

# ---- group: Join node names
text_join = TextJoin(Text=list_item, Join=";")
merge_2 = Merge(Data1=text_join)

# ----
control_knob_2 = ControlKnob(Decimals=0, Limit=False, Maximum=10, Minimum=0, Range=360, Value=24)
control_knob_3 = ControlKnob(Decimals=0, Limit=False, Maximum=10, Minimum=0, Range=360, Value=0)

_1d_member = _1DMember(
    Curve=column_lines,
    Section=cross_sections,
    Layer=layer,
    NodePrefix="BN",
    MemberPrefix="B",
    Tolerance=0.001,
    RemDuplNodes=Toggle(True),
    StructuralType=0,
    FEMtype=0,
    MemberSystemLine=1,
    Ey=0,
    Ez=0)  # -> Nodes, _1DMember
list_item_2 = ListItem(List=_1d_member._1DMember, Index=0, Wrap=True)  # -> flatten(Item)

_2d_member = _2DMember(
    Surface=surface_top_bottom,
    Material="C20/25",
    Thickness=panel_2,
    Layer=layer_2,
    InternalNodes=merge_2,
    NodePrefix="SN",
    Tolerance=0.001,
    RemDuplNodes=Toggle(True),
    MemberSystemPlane=1,
    EccentricityZ=0,
    FEMNonlinearModel=0,
    MemberPrefix="S",
    SwapOrientation=False,
    LCSangle=control_knob)  # -> Nodes, _2DMember
list_item_3 = ListItem(List=_2d_member._2DMember, Index=0, Wrap=True)  # -> flatten(Item)
list_item_4 = ListItem(List=list_item_3, Index=0, Wrap=True)  # -> Item, Item1

beam = Panel("B2")
start_cs = Panel("CS7")
end_cs = Panel("CS8")

load_panel = LoadPanel(
    Surface=flatten(surface_for_load_panels),
    Layer="LoadPanels",
    PanelType=0,
    TransferDirection=2,
    TransferMethod=1,
    NodePrefix="LPN",
    Tolerance=0.001,
    RemDuplNodes=Toggle(True),
    MemberPrefix="LP",
    SwapOrientation=False,
    LCSangle=[control_knob_3, control_knob_2])  # -> Nodes, LoadPanel

# ----
# Structure
internal_edge_on_2d_member = InternalEdgeOn2DMember(
    Line=line_internal_surface_edge,
    MemberName=list_item_3,
    EdgePrefix="ES",
    NodePrefix="NEN",
    Tolerance=0.001,
    RemDuplNodes=False)  # -> Nodes, InternalEdge
opening = Opening(ClosedCurve=polyline_3, Surface=list_item_4.Item, NodePrefix="NO", Tolerance=0.001, OpeningPrefix="O")  # -> Nodes, Opening
list_item_5 = ListItem(List=load_panel.Nodes, Index=0, Wrap=True)  # -> flatten(Item)

arbitraryprofile = ArbitraryProfile(Beams=beam, NamePrefix="AP", Section=start_cs, CoordDefinition=1, TypeOfCss=2, Css1=start_cs, Css2=end_cs, Alignment=0)

sections = Panel("""CS1;FORM-1;HEB200;S 235
CS2;FORM-1;HEA200;S 235
CS3;FORM-4;L100X8;S 235
CS4;FORM-4;L80X8;S 235
CS5;FORM-4;L70X5;S 355
CS6;FORM-11;RD20;S 355
CS7;CONC;RECT1200x300;C30/37
CS8;CONC;RECT800x900;C30/37
CS10;CONC;TSEC1200x300x150x75;C30/37
CS11;CONC;ISEC1200x400x300x200x150x75;C30/37
CS12;CONC;LSEC1000x300x100x75;C30/37
CS13;CONC;LREV1000x300x100x75;C30/37
CS14;TIMB;RECT450x450;C14 (EN 338)
CS15;TIMB;CIRC400;C14 (EN 338)
CS16;TIMB;ISEC500x45x450x30x600x20;C14 (EN 338)
CS17;TIMB;TSEC500x45x450x30;C14 (EN 338)""")
cross_sections_2 = Cross_Sections(Sections=sections)

layer_definitions = Panel("""Beams;Layer for beams;no
Surfaces;Layer for surfaces;no
LoadPanels;Layer for surfaces;no""")
layers = Layers(LayerDefinition=layer_definitions)

# ----
# FYI: InternalNodes are not connected to the member in SCIA. This is a bug. Don't use internal nodes or connect them using the 'Connect Members/Nodes' command in SCIA
internal_node_on_1d_member = InternalNodeOn1DMember(Point=evaluate_curve.Point, MemberName=list_item_2, NodePrefix="IBN")

project_materials = ValueList({"Concrete", "Steel", "Timber", "Aluminium", "Masonry"}, selected=["Concrete", "Steel", "Timber"])
mesh_size = Slider(0.5, range=0.1..2)
scale = Slider(0, range=-3..3, expression="10^x")
# General
project_name = Panel("Stuff")
author = Panel("Me")
time = Time(638472225790000000)

projectdata = ProjectData(
    ProjectName=project_name,
    Description=project_name,
    Author=author,
    Date=time,
    StructureType=8,
    Materials=project_materials,
    MeshSize=mesh_size,
    Scale=scale,
    RemDuplNodes=Toggle(True),
    Tolerance=0.001)

# ---- group: All Nodes
merge_3 = Merge(
    Data1=flatten(node),
    Data2=flatten(_1d_member.Nodes),
    Data3=flatten(_2d_member.Nodes),
    Data4=flatten(opening.Nodes),
    Data5=flatten(load_panel.Nodes),
    Data6=flatten(internal_edge_on_2d_member.Nodes))

# ----
A = StartPoint(Point(3.587175359, 0.5224049389, 0))
B = EndPoint(Point(4.140812639, 0.4779668476, 0))
A_2 = StartPoint(Point(4.191153889, 1.183145484, 0))
B_2 = EndPoint(Point(3.686518926, 1.009454481, 0))
panel_3 = Panel("""-1;-1
0;0
1;1""")
line_2 = Line(StartPoint=B, EndPoint=A_2)
line_3 = Line(StartPoint=A, EndPoint=B)
line_4 = Line(StartPoint=A_2, EndPoint=B_2)
line_5 = Line(StartPoint=B_2, EndPoint=A)
nonlinearfunction = NonlinearFunction(Name="NFL1", Type=0, PositiveEnd=0, NegativeEnd=0, GrahpPoints=panel_3)
boundary_surfaces = BoundarySurfaces(Edges=[line_3, line_2, line_5, line_4])
panel_4 = Panel("""N1
N2
N3
N4""")
line_6 = Line(StartPoint=Point(0.7872880502, 0.5798496115, 0), EndPoint=Point(3.107454536, 0.5574897246, 0))
nonlinearfunction_2 = NonlinearFunction(Name="NFL2", Type=2, PositiveEnd=0, NegativeEnd=0, GrahpPoints=panel_3)
linemomentonedge = LineMomentOnEdge(
    LoadCase="LC2",
    _2DMemberEdgeList="S1;1;edge",
    CoordSys=0,
    Direction=2,
    Distribution=0,
    LoadValue1=-100,
    LoadValue2=-100,
    CoordDefinition=0,
    Position1=0,
    Position2=1,
    Origin=0)
freepointmoment = FreePointMoment(
    LoadCase="LC2",
    Validity=0,
    Selection=0,
    CoordSys=4,
    Direction=0,
    LoadValue=-150,
    Points=Point(3.978138365, 2.025548552, 0),
    ValidityFrom=0,
    ValidityTo=0)
freelineload = FreeLineLoad(
    LoadCase="LC2",
    Validity=0,
    Selection=0,
    CoordSys=0,
    Direction=2,
    Distribution=0,
    LoadValue1=-1,
    LoadValue2=-1,
    Lines=line_6,
    ValidityFrom=0,
    ValidityTo=0)
edgesupport = EdgeSupport(
    ListOfMembers_Edges_Type="S1;SURFACE;1",
    Rx=2,
    Ry=2,
    Rz=2,
    Tx=2,
    Ty=2,
    Tz=7,
    StiffnessRx=10,
    StiffnessRy=20,
    StiffnessRz=30,
    StiffnessTx=40,
    StiffnessTy=50,
    StiffnessTz=60,
    CoordDefinition=0,
    Position1=0.25,
    Position2=0.5,
    Origin=0,
    FunctionTz="NFL1")
freesurfaceload = FreeSurfaceLoad(
    LoadCase="LC2",
    Validity=0,
    Selection=0,
    CoordSys=0,
    Direction=2,
    LoadValue=-1,
    Boundaries=boundary_surfaces,
    ValidityFrom=0,
    ValidityTo=0)
subsoil = Subsoil(
    SubsoilName="Subsoil0",
    Description="Defined sobsoil for surface support",
    C1x=50,
    C1y=50,
    C1z=50,
    C2x=0,
    C2y=0,
    C1ztype=1,
    NonlinearFunction="NFL2")
freepointload = FreePointLoad(
    LoadCase="LC2",
    Validity=0,
    Selection=0,
    CoordSys=4,
    Direction=2,
    LoadValue=-1,
    Points=Point(4.025064737, 2.952786619, 0),
    ValidityFrom=0,
    ValidityTo=0)
surfacesupport = SurfaceSupport(SurfList="S1", Subsoil="Subsoil0")
surfaceload = SurfaceLoad(LoadCase="LC2", SurfList="S1", CoordSys=0, Direction=2, LoadValue=-4)

# ---- group: The magic
filename = Panel("C:/TEMP/KoalaSoup.xml")
boolean_toggle = BooleanToggle(True)

# ----
koalaloadcases_groups = KoalaLoadCases(LoadCases="LC2; Permanent; LG1", LoadGroups="LG2; Variable; Standard")  # -> LoadCases, LoadGroups
nodesupport = NodeSupport(
    ListOfNodes=panel_4,
    Rx=1,
    Ry=1,
    Rz=1,
    Tx=1,
    Ty=1,
    Tz=1,
    StiffnessRx=0,
    StiffnessRy=0,
    StiffnessRz=0,
    StiffnessTx=0,
    StiffnessTy=0,
    StiffnessTz=0,
    Angle="Rx20,Ry20,Rz20")

# ---- group: The magic
# Create XML
createxml = CreateXML(
    Run=boolean_toggle,
    FileName=filename,
    ProjectData=flatten(projectdata),
    Layer=flatten(layers),
    CrossSection=flatten(cross_sections_2),
    Node=flatten(merge_3),
    _1DMember=flatten(_1d_member._1DMember),
    _2DMember=flatten(_2d_member._2DMember),
    LoadPanel=flatten(load_panel.LoadPanel),
    Opening=flatten(opening.Opening),
    ArbitraryProfile=flatten(arbitraryprofile),
    InternalNode1D=flatten(internal_node_on_1d_member),
    InternalEdge2D=flatten(internal_edge_on_2d_member.InternalEdge))

# ----
boolean_toggle_2 = BooleanToggle(True)
button = Button()
boolean = Boolean(True)
createxml_old = CreateXML(
    StructureType=8,
    UILanguage=0,
    Materials="Concrete",
    MeshSize=0.15,
    Sections=cross_sections_2,
    Nodesupports=nodesupport,
    Edgesupports=edgesupport,
    Loadcases=koalaloadcases_groups.LoadCases,
    Loadgroups=koalaloadcases_groups.LoadGroups,
    Surfaceloads=surfaceload,
    FreePointloads=freepointload,
    FreelLineloads=freelineload,
    FreeSurfaceloads=freesurfaceload,
    FileName="C:/TEMP/2Dmember.xml",
    Scale="1",
    RemDuplNodes=boolean_toggle_2,
    OnDemand=boolean_toggle_2,
    Subsoils=subsoil,
    SurfaceSupports=surfacesupport,
    LineMomentsOnEdge=linemomentonedge,
    FreeMomentPoints=freepointmoment,
    NonlinearFunctions=[nonlinearfunction_2, nonlinearfunction],
    Tolerance=0.001)  # disabled
createxml_2 = CreateXML(
    Run=boolean,
    FileName="C:/TEMP/2Dmember.xml",
    CrossSection=flatten(cross_sections_2),
    NodeSupport=flatten(nodesupport),
    SurfaceEdgeSupport=flatten(edgesupport),
    SurfaceSupport=flatten(surfacesupport),
    Subsoil=flatten(subsoil),
    LoadCase=flatten(koalaloadcases_groups.LoadCases),
    LoadGroup=flatten(koalaloadcases_groups.LoadGroups),
    FreePointLoad=flatten(freepointload),
    FreePointMoment=flatten(freepointmoment),
    LineMomentEdge=flatten(linemomentonedge),
    FreeLineLoad=flatten(freelineload),
    SurfaceLoad=flatten(surfaceload),
    FreeSurfaceLoad=flatten(freesurfaceload),
    NonLinearFunction=flatten([nonlinearfunction_2, nonlinearfunction]))  # disabled
data_recorder = DataRecorder(createxml_old, DataLimit=-10, RecordData=True)
panel_5 = Panel(data_recorder)
